% Simulink data dictionary AOTDataDictionary.sldd

Acceleration_ISO = Simulink.Bus()
  xddot: double
  yddot: double
  zddot: double

AngVel_ISO = Simulink.Bus()
  p: double
  q: double
  r: double

Orientation_ISO = Simulink.Bus()
  phi: double
  theta: double
  psi: double

Position_ISO = Simulink.Bus()
  X: double
  Y: double
  Z: double

Velocity_ISO = Simulink.Bus()
  Xdot: double
  Ydot: double
  Zdot: double

VehPgons = Simulink.Bus()
  NumVeh: double
  VehPgon: Bus: Polygon[2 1]

DriverCmd = Simulink.Bus()
  SteerCmd: double
  AccelCmd: double
  DecelCmd: double
  GearCmd: double

CurrentManeuver = enum(DefaultValue="LaneKeep", AddClassNameToEnumNames=true)
  LaneKeep = 0
  Overtake = 1

Position2D = Simulink.Bus()
  X: double
  Y: double

Veh_Fdbk = Simulink.Bus()
  Position: Position_ISO
  Velocity: Velocity_ISO
  Acceleration: Acceleration_ISO
  Orientation: Orientation_ISO
  AngVel: AngVel_ISO

BusActors = Simulink.Bus()
  NumActors: double
  Time: double
  Actors: Bus: BusActorsActors[2 1]

BusActorsActors = Simulink.Bus()
  ActorID: double
  Position: double[1 3]
  Velocity: double[1 3]
  Roll: double
  Pitch: double
  Yaw: double
  AngularVelocity: double[1 3]

BusLaneBoundaries = Simulink.Bus()
  NumLaneBoundaries: double
  Time: double
  LaneBoundaries: Bus: BusLaneBoundariesLaneBoundaries[7 1]

BusLaneBoundariesLaneBoundaries = Simulink.Bus()
  Coordinates: double[401 3]
  Curvature: double[401 1]
  CurvatureDerivative: double[401 1]
  HeadingAngle: double
  LateralOffset: double
  BoundaryType: uint8
  Strength: double
  Width: double
  Length: double
  Space: double

BusVehicleToWorldActors = Simulink.Bus()
  NumActors: double
  Time: double
  Actors: Bus: BusActorsActors[2 1]

BusObjectDetections = Simulink.Bus()
  NumDetections: double
  IsValidTime: boolean
  Detections: Bus: BusObjectDetectionsDetections[50 1]

BusObjectDetectionsDetections = Simulink.Bus()
  Time: double
  Measurement: double[6 1]
  MeasurementNoise: double[6 6]
  SensorIndex: double
  ObjectClassID: double
  ObjectAttributes: Bus: BusObjectDetectionsDetectionsObjectAttributes
  MeasurementParameters: Bus: BusObjectDetectionsDetectionsMeasurementParameters

BusObjectDetectionsDetectionsObjectAttributes = Simulink.Bus()
  TargetIndex: double

BusObjectDetectionsDetectionsMeasurementParameters = Simulink.Bus()
  Frame: Enum: drivingCoordinateFrameType
  OriginPosition: double[3 1]
  Orientation: double[3 3]
  HasVelocity: boolean

BusLaneDetections = Simulink.Bus()
  Time: double
  IsValidTime: boolean
  SensorIndex: double
  NumLaneBoundaries: double
  LaneBoundaries: Bus: BusLaneDetectionsLaneBoundaries[30 1]

BusLaneDetectionsLaneBoundaries = Simulink.Bus()
  Curvature: double
  CurvatureDerivative: double
  CurveLength: double
  HeadingAngle: double
  LateralOffset: double
  BoundaryType: uint8
  Strength: double
  Width: double

enable_MPC = 0

Polygon = Simulink.Bus()
  X: double[6 1]
  Y: double[6 1]

CntrlHor = 10
Dmax = 3
L = 3.705

MPCparams = Simulink.Bus()
  ellip_coeff: double[1 6]

PredHor = 10
ReachableSetCurveResolution = 0.1
ReachableSet_MaxVertices = 200
RiskMaxValue = 100
RiskValueThreshold = 15
SenseResolution = 0.1
T_horizon = 2
XSenseRange = 20
XSenseRangeArrSize = 401
YSenseRange = 20
YSenseRangeArrSize = 401
abortTrigger = 0
controllerSampleTime = 0.1
distOvertakeTrigger = 5
distSafeLaneKeep = 10
distSafeOvertakeZone = 10
dt = 0.05
eetaRoad = 5
egoAccMax = 5
egoAccMin = -5
egoMaxSteeringWheelAng = 9.424778
egoSteerAngMax = 0.5235988
egoSteerAngMin = -0.5235988
egoSteeringRatio = 18
egoVehHeight = 1.37
egoVehLength = 4.948
egoVehWheelbase = 3.02
egoVehWidth = 2.009
egoVehcenterToFront = 1.491
egoVehcenterToRear = 1.529
egoVehfrontOverhang = 0.983
egoVehrearOverhang = 0.945
ellipCoeffValidateFcns = [2 2 2 2 2 6]
gamma = 0.5
inflationFactor = 1.1
inflationFactorMpcOA = 1.15
inflexPoint = 0
l_F = 1.2525
npcVehHeight = 1.517
npcVehLength = 4.848
npcVehWheelbase = 2.818
npcVehWidth = 1.842
npcVehcenterToFront = 1.513
npcVehcenterToRear = 1.305
npcVehfrontOverhang = 0.911
npcVehrearOverhang = 1.119
nu = 2
nx = 4
ny = 4
obstcl_ellip_order = 6
plotSampleTime = 0.1
t = 0
tf = 2
uValidateFcns = [0.4 0]
v_des = 15
xValidateFcns = [2 0 -1.570796 0.3]